# Grasshopper definition FirstTests.gh (Grasshopper 1.0.8)
# plug-ins: RhinoCodePluginGH

button = Button()
py3 = Python3Script(realtime=Button(), get_image=Button(), get_pointcloud=Toggle(False), clean=Button())  # -> out, point_cloud
# ---------- py3: Python ----------
# env: D:/OneDrive - Politecnico di Milano/Repos/orbbec-astra/
# r: pyyaml, open3d-python, open3d, scipy, primesense, opencv-python, pyapriltags
from depthCamera.depthCam import *
from scriptcontext import sticky as st
import ghpythonlib.treehelpers as th
from Rhino.Geometry import PointCloud, Point3d
from System.Drawing import Color

pointcloud = st.get("pointcloud", None)
print(python.__version__)
d = DepthCamera()

if realtime:
    d.realtime_apriltag_detection()

if get_image:
    d.display_color_data_with_apriltags()

if get_pointcloud:
    points, colours = d.display_registered_point_cloud(duration=1, num_points=1)
    p = PointCloud()

    for i, point in enumerate(points):
        c = colours[i]
        c = [int(c_i*255) for c_i in c]
        colour = Color.FromArgb(c[0], c[1], c[2])
        point_gh = Point3d(point[0], point[1], point[2])
        print(point_gh)
        print(colour)
        # p.Add()
        # st["pointcloud"] = p
        
if clean:
    pass
    
d.cleanup()
point_cloud = st.get("pointcloud", None)
# ---------- end py3 ----------
image = ImageSampler(Filter="Colour", Interpolate=False, Umax=1, Umin=0, Vmax=1, Vmin=0, Wrap=1)
